# Grasshopper definition Hops_FitCrv.gh (Grasshopper 1.0.7)
# plug-ins: Hops

hops = Hops(
    _Path="http://127.0.0.1:5000/sum",
    A=Slider(5, range=0..10),
    B=Slider(3, range=0..10),
    CacheResultsInMemory=False,
    CacheSolveResults=False,
    RemoteDefinitionLocation="http://127.0.0.1:5000/sum",
    RemoteSolveVersion=(0, 1, 0),
    ShowInput_Enabled=False,
    ShowInput_Path=True,
    SynchronousSolve=True)
panel = Panel(hops)

pt = Point([Point(52.92518196, 56.97934778, 0), Point(39.47958313, 43.04293614, 0), Point(27.19496648, 42.97168453, 0), Point(58.02386369, 26.84995886, 0), Point(9.241655194, 20.22565432, 0), Point(60.8605306, 6.394607573, 0), Point(58.4115563, 23.70650527, 0), Point(44.99948764, 74.79724611, 0), Point(35.2506662, 57.34233806, 0), Point(20.69011318, 38.37595537, 0), Point(5.811099506, 15.53352593, 0), Point(60.7167556, 11.55810495, 0), Point(52.60066795, 66.82229344, 0), Point(13.0578596, 27.06979814, 0), Point(19.23082177, 31.87948461, 0)])
pt_2 = Point([Point(91.93503655, 0.06782535392, 0), Point(94.90304869, 20.10190727, 0), Point(105.2910912, 5.26184659, 0), Point(109.7431094, 21.58591333, 0), Point(117.9051427, 30.48994974, 0), Point(120.1311518, 6.745852658, 0), Point(127.4806177, 23.0699194, 0), Point(116.4211367, 44.58800738, 0), Point(126.8091791, 56.46005592, 0), Point(139.4232307, 29.7479467, 0), Point(143.1332459, 52.00803772, 0), Point(142.3912428, 68.33210446, 0), Point(164.6513339, 45.33001041, 0), Point(160.1993157, 63.13808322, 0), Point(156.4893005, 82.4301621, 0), Point(149.2400619, 44.58800738, 0), Point(132.1739921, 40.87799221, 0), Point(178.7539266, 77.23614087, 0)])
hops_2 = Hops(
    _Path="http://127.0.0.1:5000/fitCurve",
    Points=pt_2,
    Objective=Slider(0, range=0..4),
    CacheResultsInMemory=False,
    CacheSolveResults=False,
    RemoteDefinitionLocation="http://127.0.0.1:5000/fitCurve",
    RemoteSolveVersion=(0, 1, 0),
    ShowInput_Enabled=False,
    ShowInput_Path=True,
    SynchronousSolve=True)  # -> Success, FitCurve
hops_3 = Hops(
    _Path="http://127.0.0.1:5000/plotFit",
    Plot=Toggle(False),
    Points=pt_2,
    Curve=hops_2.FitCurve,
    FileName="plt2",
    CacheResultsInMemory=True,
    CacheSolveResults=True,
    RemoteDefinitionLocation="http://127.0.0.1:5000/plotFit",
    RemoteSolveVersion=(0, 1, 0),
    ShowInput_Enabled=False,
    ShowInput_Path=True,
    SynchronousSolve=True)

srf = Surface(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)
md_slider = MDSlider(
    SliderMode=0,
    slider_value=Point(0.5572782377, 0.5923536347, 0.5),
    x_domain=Domain(0, 1),
    y_domain=Domain(0, 1),
    z_domain=Domain(0, 1))
popgeo = PopulateGeometry(Geometry=srf, Count=Slider(100, range=0..10000), Seed=1)
hops_4 = Hops(
    _Path="http://127.0.0.1:5000/savePoints",
    Points=popgeo,
    CacheResultsInMemory=False,
    CacheSolveResults=False,
    RemoteDefinitionLocation="http://127.0.0.1:5000/savePoints",
    RemoteSolveVersion=(0, 1, 0),
    ShowInput_Enabled=False,
    ShowInput_Path=True,
    SynchronousSolve=True)  # disabled
evalsrf = EvaluateSurface(Surface=reparameterize(srf), Point=md_slider)  # -> Point, Normal, UDirection, VDirection, Frame
hops_5 = Hops(
    _Path="http://127.0.0.1:5000/predictPoint",
    Points=evalsrf.Point,
    CacheResultsInMemory=False,
    CacheSolveResults=False,
    RemoteDefinitionLocation="http://127.0.0.1:5000/predictPoint",
    RemoteSolveVersion=(0, 1, 0),
    ShowInput_Enabled=False,
    ShowInput_Path=True,
    SynchronousSolve=True)
panel_2 = Panel(evalsrf.Point)
panel_3 = Panel(hops_5)
